# Grasshopper definition LCA.gh (Grasshopper 1.0.8)

panel = Panel("""concrete C30/37
219""")
panel_2 = Panel("""steel
1.125""")
panel_3 = Panel("""timber
60""")
panel_4 = Panel("file.xlsx")
panel_5 = Panel("""concrete
steel
timber""")
panel_6 = Panel("""m3
kg
m3""")
entwine = Entwine(Branch00=panel, Branch01=panel_2, Branch02=panel_3, FlattenInputs=True)
excel_data = Data(entwine)
tmatch = MatchText(Text=excel_data, RegEx=panel_5, Case=True)
cull = CullPattern(List=excel_data, CullPattern=invert(tmatch))
m_objects = QueryModelObjects(Layer=panel_5, Locked=True, Hidden=True, AutoUpdateState=True)  # -> simplify(Objects)
item = ListItem(List=cull, Index="1", Wrap=True)  # -> flatten(Item)
volume = Volume(Geometry=m_objects)  # -> Volume, Centroid
ma = MassAddition(Input=volume.Volume)  # -> flatten(Result), PartialResults
py3 = Python3Script(emission_factors=item, material=panel_5, qty=ma.Result, unit=panel_6)  # -> carbon, error
# ---------- py3: Python ----------
"""Grasshopper Script"""

# Embodied Carbon Calculator Script - grasshopper port
# wbinder
# 16.12.2025
if qty != None:
    if unit == "m3":
        print(material)
        print(round(qty), unit)
        print(round(float(emission_factors)*float(qty),2), "kgC02e")
        error = ""
    if unit == "kg":
        density_steel = 7850 #for steel... adjust later to be dynamic with excel database
        print(material)
        print(round(qty*density_steel), unit)
        print(round(float(emission_factors)*density_steel*float(qty),2), "kgC02e")
        error = ""

else:
    error = "error in quantity"

# Calculate embodied carbon for each material


# Total embodied carbon
#carbon = concrete_carbon + steel_carbon + timber_carbon
# ---------- end py3 ----------
panel_7 = Panel(py3.carbon)
panel_8 = Panel(py3.error)
